# Grasshopper definition sundialGrasshopper.gh (Grasshopper 1.0.7)

panel = Panel("/Users/philippschneider/Documents/GitHub/parametric-sundial/output/P0.csv")
panel_2 = Panel("/Users/philippschneider/Documents/GitHub/parametric-sundial/output/P1.csv")
panel_3 = Panel("/Users/philippschneider/Documents/GitHub/parametric-sundial/output/minScale.csv")
panel_4 = Panel("/Users/philippschneider/Documents/GitHub/parametric-sundial/output/P.csv")
panel_5 = Panel("/Users/philippschneider/Documents/GitHub/parametric-sundial/output/points_gnomon_from21june.csv")
panel_6 = Panel("/Users/philippschneider/Documents/GitHub/parametric-sundial/output/hourScale.csv")
axis0 = ImportCoordinates(File=panel, Separator=",", XIndex=0, YIndex=1, ZIndex=2)
axis1 = ImportCoordinates(File=panel_2, Separator=",", XIndex=0, YIndex=1, ZIndex=2)
gnomon = ImportCoordinates(File=panel_4, Separator=",", XIndex=0, YIndex=1, ZIndex=2)
hourscale = ImportCoordinates(File=panel_6, Separator=",", XIndex=0, YIndex=1, ZIndex=2)
minscale = ImportCoordinates(File=panel_3, Separator=",", XIndex=0, YIndex=1, ZIndex=2)
dom = ConstructDomain(DomainStart=Slider(1140, range=1..1441), DomainEnd=Slider(300, range=1..1441))
line = Line(StartPoint=axis0, EndPoint=axis1)
sub_list = SubList(List=minscale, Domain=dom, Wrap=True)  # -> List, Index
normal = Line(line)
offsetgnomonscale = Slider(-0.11, range=-0.2..0.2)
offsetgnomonscale_2 = Slider(-0.049, range=-0.2..0.2)
interpolate = Interpolate(Vertices=gnomon, Degree=3, Periodic=False, KnotStyle=1)  # -> Curve, Length, Domain
interpolate_2 = Interpolate(Vertices=sub_list.List, Degree=3, Periodic=False, KnotStyle=1)  # -> Curve, Length, Domain
start = ListItem(List=gnomon, Index=0, Wrap=True)
end = ListItem(List=gnomon, Index=-1, Wrap=True)
end_points = EndPoints(Curve=interpolate_2.Curve)  # -> Start, End
point = Point(end_points.Start)
point_2 = Point(end_points.End)
point_3 = Point(end)
point_4 = Point(start)
scale = Scale(Geometry=normal, Center=Point(0, 0, 0), Factor=offsetgnomonscale)  # -> Geometry, Transform
scale_2 = Scale(Geometry=normal, Center=Point(0, 0, 0), Factor=offsetgnomonscale_2)  # -> Geometry, Transform
scalecurve = Curve(interpolate_2.Curve)
curve_closest_point = CurveClosestPoint(Point=point_3, Curve=normal)  # -> Point, Parameter, Distance
curve_closest_point_2 = CurveClosestPoint(Point=point_4, Curve=normal)  # -> Point, Parameter, Distance
point_5 = Point(curve_closest_point.Point)
move = Move(Geometry=point_5, Motion=scale.Geometry)  # -> Geometry, Transform
move_2 = Move(Geometry=point_5, Motion=scale_2.Geometry)  # -> Geometry, Transform
offsetpoint = Point(move_2.Geometry)
offsetpoint_2 = Point(move.Geometry)
point_6 = Point(curve_closest_point_2.Point)
line_2 = Line(StartPoint=point_6, EndPoint=point_4)
line_3 = Line(StartPoint=point_3, EndPoint=point_5)
gnomoncurve = Curve(interpolate.Curve)
scale_3 = Scale(Geometry=normal, Center=Point(0, 0, 0), Factor=Slider(-5, range=-5..1))  # -> Geometry, Transform
catenary = Catenary(PointA=offsetpoint, PointB=point, Length=Slider(0.1167, range=0..0.2), Gravity=scale_3.Geometry)
catenary_2 = Catenary(PointA=offsetpoint_2, PointB=point, Length=Slider(0.1223, range=0..0.2), Gravity=scale_3.Geometry)
gnomonfullcurve = Curve([line_2, gnomoncurve, line_3])
line_4 = Line(StartPoint=offsetpoint_2, EndPoint=offsetpoint)
curve = Curve([catenary_2, catenary, line_4])
revolution = Revolution(Curve=gnomonfullcurve, Axis=normal, Domain=Domain(0, 6.283185307))
join_curves = JoinCurves(Curves=flatten([line_4, catenary_2, catenary]), Preserve=False)
vec2pt = Vector2Pt(PointA=curve_closest_point.Point, PointB=axis0, Unitize=False)  # -> Vector, Length
item = ListItem(List=revolution, Index=2, Wrap=True)
sweep1 = Sweep1(Rail=scalecurve, Sections=join_curves, Miter=1)
scale_4 = Scale(Geometry=vec2pt.Vector, Center=Point(0, 0, 0), Factor=Slider(1.41, range=0..2))  # -> Geometry, Transform
extr = Extrude(Base=item, Direction=scale_4.Geometry)
