# Grasshopper definition unnamed.gh (Grasshopper 1.0.7)

panel = Panel("D:\Philipp\2-CodeProjects\3-python\solardial\output\hourScale.csv")
panel_2 = Panel("D:\Philipp\2-CodeProjects\3-python\solardial\output\minScale.csv")
gnomon = ImportCoordinates(File="D:\Philipp\2-CodeProjects\3-python\solardial\output\P.csv", Separator=",", XIndex=0, YIndex=1, ZIndex=2)
dom = ConstructDomain(DomainStart=Slider(1140, range=1..1441), DomainEnd=Slider(300, range=1..1441))
minscale = ImportCoordinates(File=panel, Separator=",", XIndex=0, YIndex=1, ZIndex=2)
axis0 = ImportCoordinates(File="D:\Philipp\2-CodeProjects\3-python\solardial\output\P0.csv", Separator=",", XIndex=0, YIndex=1, ZIndex=2)
axis1 = ImportCoordinates(File="D:\Philipp\2-CodeProjects\3-python\solardial\output\P1.csv", Separator=",", XIndex=0, YIndex=1, ZIndex=2)
minscale_2 = ImportCoordinates(File=panel_2, Separator=",", XIndex=0, YIndex=1, ZIndex=2)
list = ValueList({"1"}, selected="1")
normal = Line(StartPoint=axis0, EndPoint=axis1)
item = ListItem(List=gnomon, Index=list, Wrap=True)
subset = SubList(List=minscale_2, Domain=dom, Wrap=True)  # -> List, Index
intcrv = Interpolate(Vertices=gnomon, Degree=3, Periodic=False, KnotStyle=1)  # -> Curve, Length, Domain
sph = Sphere(Base=minscale, Radius=Slider(0.002, range=0..0.01))
list_2 = ValueList({"180"}, selected="180")
unit = UnitVector(Vector=normal)
intcrv_2 = Interpolate(Vertices=subset.List, Degree=3, Periodic=False, KnotStyle=1)  # -> Curve, Length, Domain
item_2 = ListItem(List=gnomon, Index=list_2, Wrap=True)
scale = Scale(Geometry=unit, Center=Point(0, 0, 0), Factor=Slider(-0.02, range=-0.05..0.05))  # -> Geometry, Transform
crv_cp = CurveClosestPoint(Point=item_2, Curve=normal)  # -> Point, Parameter, Distance
crv_cp_2 = CurveClosestPoint(Point=item, Curve=normal)  # -> Point, Parameter, Distance
move = Move(Geometry=intcrv_2.Curve, Motion=scale.Geometry)  # -> Geometry, Transform
scale_2 = Scale(Geometry=unit, Center=Point(0, 0, 0), Factor=Slider(-0.05, range=-0.1..0.1))  # -> Geometry, Transform
circle = CircleCNR(Center=crv_cp_2.Point, Normal=normal, Radius=crv_cp_2.Distance)
circle_2 = CircleCNR(Center=crv_cp.Point, Normal=normal, Radius=crv_cp.Distance)
pl = PlaneNormal(Origin=scale_2.Geometry, ZAxis=Vector(0, 0, 1))
scale_3 = Scale(Geometry=unit, Center=Point(0, 0, 0), Factor=Slider(-0.01, range=-0.05..0))  # -> Geometry, Transform
scale_4 = Scale(Geometry=move.Geometry, Center=axis0, Factor=Slider(0.148, range=0..1.01))  # -> Geometry, Transform
rulesrf = RuledSurface(CurveA=intcrv_2.Curve, CurveB=scale_4.Geometry)
Z = UnitZ(Factor=Slider(-0.08, range=-0.1..0.1))
extr = Extrude(Base=rulesrf, Direction=scale_3.Geometry)
move_2 = Move(Geometry=pl, Motion=Z)  # -> Geometry, Transform
swp2 = Sweep2(Rail1=circle, Rail2=circle_2, Sections=intcrv.Curve, SameHeight=False)
scale_5 = Scale(Geometry=unit, Center=Point(0, 0, 0), Factor=Slider(-0.15, range=-1..0))  # -> Geometry, Transform
boundary = BoundarySurfaces(Edges=circle_2)
cyl = Cylinder(Base=move_2.Geometry, Radius=Slider(0.11, range=-0.1..0.2), Length=Slider(-0.01, range=-0.1..0.1))
brep = Brep(extr)
extr_2 = Extrude(Base=boundary, Direction=scale_5.Geometry)
sdiff = SolidDifference(BrepsA=brep, BrepsB=sph)
cap = CapHoles(Brep=cyl)
boundary_2 = BoundarySurfaces(Edges=circle)
brep_2 = Brep(extr_2)
brep_3 = Brep(boundary_2)
brep_4 = Brep(swp2)
brep_5 = Brep(cap)
